# Grasshopper definition hextile_components.gh (Grasshopper 1.0.8)
# plug-ins: RhinoCodePluginGH, Githopper

pt = Point(Point(0.5134748452, 0.9227445607, 0))

# ----
# say.hi.to.ting@gmail.com
button = Button()
panel = Panel("D:\__googledrive\My Drive\_Home\Projects\Coding\Reptile\repo\repTile")
panel_2 = Panel("https://github.com/sayhitoting/repTile")
push = PushToRepository(Repository=panel_2, Push=button)
panel_3 = Panel("sayhitoting")
path = GitPath(Path=panel, Set=Button())  # -> Report, Help
remote = SetRemoteAddress(URL=panel_2, Set=Button())  # -> Report, Help
commits = CommitList(Check=Button())
status = CheckStatus(Check=Button())
commit = CommitChanges(Message="integrate global classes through sticky dictionary", Commit=Button())  # -> Report, Help
panel_4 = Panel(commits)
panel_5 = Panel(status)
panel_6 = Panel(path.Report)

rephexagon = Python3Script(
    ptOrigin=pt,
    length1=Slider(7.4, range=-10..10),
    length2=Slider(3.1, range=-10..10),
    length3=Slider(5.2, range=-10..10),
    angle1=Slider(80, range=0..360),
    angle2=Slider(131, range=0..360))  # -> out, firstHexObj, crvFirstHex, ptsFirstHex, crvsHexEdges, ptFirstHexCentroid; inputs ptOrigin: tree of Point3d
#   port ptOrigin: Start point of Hexagonal tesselation.
# ---------- rephexagon: Python ----------
"""Grasshopper Script"""

import ghpythonlib.components as gh 
import scriptcontext as sc
import math as m 

# Draw  hexagon
def drawHexagon (centroid):
    ptsHexagon = []
    numsOrigin = gh.PointstoNumbers(centroid, "XYZ") 
    plane = gh.XYPlane(gh.NumberstoPoints([0,0,0], "XYZ"))

    # draw hexagon vertices, counterclockwise
    pt0= gh.NumberstoPoints([numsOrigin[0], numsOrigin[1],  numsOrigin[2]], "XYZ")
    ptsHexagon.append(pt0)

    vec1 = gh.VectorXYZ(length1, 0, 0).vector #start point
    pt1= gh.Move(pt0, vec1).geometry
    ptsHexagon.append(pt1)

    vec1Rev = gh.Reverse(vec1) #point 2
    vec2 = gh.UnitVector(gh.Rotate(vec1Rev, m.radians(- angle1), plane).geometry)
    pt2= gh.Move(pt1, vec2 * length2).geometry
    ptsHexagon.append(pt2)

    vec2Rev = gh.UnitVector(gh.Reverse(vec2)) #point 3
    vec3 = gh.Rotate(vec2Rev, m.radians(- angle2), plane).geometry
    pt3= gh.Move(pt2, vec3 * length3).geometry
    ptsHexagon.append(pt3)

    pt4 = gh.Move(pt3, vec1Rev).geometry #point 4
    ptsHexagon.append(pt4)

    pt5 = gh.Move(pt4, vec2Rev * length2).geometry #point 4
    ptsHexagon.append(pt5)

    # draw curves
    crvHexagon = gh.PolyLine(ptsHexagon, True)

    # explode curves into edges
    crvsHexEdges = gh.Explode(crvHexagon, False).segments

    # find centroid
    ptCentroid = gh.Average(ptsHexagon)
    
    return ptsHexagon, crvHexagon, crvsHexEdges, ptCentroid


class Hexagon:
    def __init__(self, vertices, curve, edges, centroid):
        self.curve = curve
        self.vertices = vertices
        self.edges = edges
        self.centroid = centroid

sc.sticky["repHexagon"] = Hexagon

# draw first hexagon
firstHex = drawHexagon(ptOrigin)
firstHexObj = Hexagon(firstHex[0], firstHex[1], firstHex[2], firstHex[3])

ptsFirstHex = firstHexObj.vertices
crvFirstHex = firstHexObj.curve
crvsHexEdges = firstHexObj.edges
ptFirstHexCentroid = firstHexObj.centroid
# ---------- end rephexagon ----------
crv = Curve(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)
crv_2 = Curve(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)
crv_3 = Curve(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)
midpt = CurveMiddle(Curve=rephexagon.crvsHexEdges)
rotate = Rotate(Geometry=rephexagon.crvsHexEdges, Angle=degrees(-90), Plane=midpt)  # -> Geometry, Transform
repcustomize = Python3Script(firstHexObj=rephexagon.firstHexObj, crvCustomEdge1=crv, crvCustomEdge2=crv_2, crvCustomEdge3=crv_2)  # -> out, objHex, test, crvsEdge_new; inputs crvCustomEdge1: Curve, crvCustomEdge2: Curve, crvCustomEdge3: Curve
# ---------- repcustomize: Python ----------
"""Grasshopper Script"""

import ghpythonlib.components as gh
import scriptcontext as sc

Hexagon = sc.sticky["repHexagon"]

def CustomEdgeOrient (oldEdge, customEdge):
    # old edge data
    numLength_old = gh.Length(oldEdge)
    ptsEnd_old = gh.EndPoints(oldEdge)
    vecEdge_old = gh.Vector2Pt(ptsEnd_old.start, ptsEnd_old.end, False).vector

    # custom edge data
    ptsEnd_custom= gh.EndPoints(customEdge)    
    numLength_custom = gh.Distance(ptsEnd_custom.start, ptsEnd_custom.end)
    vecEdge_custom = gh.Vector2Pt(ptsEnd_custom.start, ptsEnd_custom.end, False).vector

    # orient values
    vecMove = gh.Vector2Pt(ptsEnd_custom.start, ptsEnd_old.start ,False).vector
    numRotate = gh.Angle(vecEdge_custom, vecEdge_old).angle
    numScale = numLength_old / numLength_custom
    pln_old = gh.AlignPlane(gh.XYPlane(ptsEnd_old.start), vecEdge_old).plane
    pln_custom = gh.AlignPlane(gh.XYPlane(ptsEnd_custom.start), vecEdge_custom).plane

    # geometric scale and orientation of custom curve
    crvOriented = gh.Orient(customEdge, pln_custom, pln_old).geometry
    crvScaled = gh.Scale(crvOriented, ptsEnd_old.start, numScale).geometry
    
    
    return crvScaled
    

crvsEdge = firstHexObj.edges


# position new edge 1,4
crvEdge1_new = CustomEdgeOrient (crvsEdge[0], crvCustomEdge1)
crvEdge4_new = CustomEdgeOrient (gh.FlipCurve(crvsEdge[3]).curve, crvCustomEdge1)

# position new edge 2,5
crvEdge2_new = CustomEdgeOrient (crvsEdge[1], crvCustomEdge2)
crvEdge5_new = CustomEdgeOrient (gh.FlipCurve(crvsEdge[4]).curve, crvCustomEdge2)

# position new edge 3,6
crvEdge3_new = CustomEdgeOrient (crvsEdge[2], crvCustomEdge3)
crvEdge6_new = CustomEdgeOrient (gh.FlipCurve(crvsEdge[5]).curve, crvCustomEdge3)

# reorder edge list
crvsEdge_new = []
crvsEdge_new.append(crvEdge1_new)
crvsEdge_new.append(crvEdge2_new)
crvsEdge_new.append(crvEdge3_new)
crvsEdge_new.append(crvEdge4_new)
crvsEdge_new.append(crvEdge5_new)
crvsEdge_new.append(crvEdge6_new)

crvHexagon_new = gh.JoinCurves(crvsEdge_new, False)
ptCentroid_new = gh.Area(crvHexagon_new).centroid

objHex = Hexagon(firstHexObj.vertices, crvHexagon_new, crvsEdge_new, ptCentroid_new)
# ---------- end repcustomize ----------
item = ListItem(List=midpt, Index=0, Wrap=True)  # -> Item, Item1, Item2, Item3, Item4, Item5
line = LineSDL(Start=midpt, Direction=rotate.Geometry, Length=1)
geo = Geometry(repcustomize.crvsEdge_new)
item_2 = ListItem(List=line, Index=0, Wrap=True)  # -> Item, Item1, Item2, Item3, Item4, Item5
geo_2 = Geometry(item_2.Item3)
join = JoinCurves(Curves=repcustomize.crvsEdge_new, Preserve=False)
llx = LineLine(Line1=item_2.Item, Line2=item_2.Item2)  # -> ParamA, ParamB, PointA, PointB
llx_2 = LineLine(Line1=item_2.Item3, Line2=item_2.Item5)  # -> ParamA, ParamB, PointA, PointB
reptile = Python3Script(objHex=repcustomize.objHex, intGridSize=Slider(4, range=0..10))  # -> out, crvsHexTile; inputs intGridSize: Int32
# ---------- reptile: Python ----------
"""Grasshopper Script"""

import rhinoscriptsyntax as rs 
import ghpythonlib.components as gh 
import math as m 



# Hex tiling
ptsTileStart = []

ptsFirstHex = objHex.vertices

vecFirstMove_row = gh.Vector2Pt(ptsFirstHex[0],ptsFirstHex[2],False).vector
vecFirstMove_col = gh.Vector2Pt(ptsFirstHex[0],ptsFirstHex[4],False).vector

## grid points
ptLead = ptsFirstHex[0]
for i in range(intGridSize):
    for j in range(intGridSize):
        ptMove_row = gh.Move(ptLead, vecFirstMove_row * j).geometry
        ptsTileStart.append(ptMove_row)
    ptLead = gh.Move(ptLead, vecFirstMove_col).geometry

crvsHexTile = []
for pt in ptsTileStart:
    vecMoveTile = gh.Vector2Pt(ptsFirstHex[0], pt, False).vector
    crvHexTile = gh.Move(objHex.curve, vecMoveTile).geometry
    crvsHexTile.append(crvHexTile)
# ---------- end reptile ----------
offset = OffsetCurve(Curve=join, Distance=-0.4, Corners=1)
ln = Line(StartPoint=llx.PointA, EndPoint=llx_2.PointA)
ln_2 = Line(StartPoint=[item.Item, item.Item2], EndPoint=llx.PointA)
ln_3 = Line(StartPoint=[item.Item3, item.Item5], EndPoint=llx_2.PointA)
